# Dynamo custom node Get Basic Wall Instances.dyf (Dynamo 1.3.4.6666)
# category: Teascripts.Collections.Walls
# Retrieves the basic wall instances in the project model.

python_script = Python()  # unwired: IN[0]
# ---------- python_script.python (21 lines) ----------
import clr

clr.AddReference('RevitAPI')
clr.AddReference('RevitServices')

from Autodesk.Revit.DB import *
from RevitServices.Persistence import DocumentManager as DM


doc = DM.Instance.CurrentDBDocument

walls = FilteredElementCollector(doc).OfCategory(BuiltInCategory.OST_Walls).OfClass(Wall).WhereElementIsNotElementType().ToElements()

data = filter(lambda w: w.WallType.Kind == WallKind.Basic, walls)


#The inputs to this node will be stored as a list in the IN variables.
dataEnteringNode = IN

#Assign your output to the OUT variable.
OUT = data
# ----------------------------------------
Basic_Wall_Elements = Output(python_script)
