# Dynamo custom node Get Basic Wall Types.dyf (Dynamo 1.3.4.6666)
# category: Teascripts.Collections.Walls
# Retrieves all the basic wall types in the project model.

python_script = Python()  # unwired: IN[0]
# ---------- python_script.python (18 lines) ----------
import clr
clr.AddReference('RevitAPI')
clr.AddReference('RevitServices')

from Autodesk.Revit.DB import *
from RevitServices.Persistence import DocumentManager as DM

doc = DM.Instance.CurrentDBDocument

wallTypes = FilteredElementCollector(doc).OfCategory(BuiltInCategory.OST_Walls).OfClass(WallType).ToElements()
			
basicWalls = filter(lambda w: w.Kind == WallKind.Basic, wallTypes)

#The inputs to this node will be stored as a list in the IN variables.
dataEnteringNode = IN

#Assign your output to the OUT variable.
OUT = basicWalls
# ----------------------------------------
Basic_Wall_Types = Output(python_script)
