# Dynamo custom node CollectionsElementsOfElementTypes.dyf "Elements of Element Types" (Dynamo 1.3.3.4111)
# category: Teascripts.Collections.Element
# Retrieves the elements of element type

Element_Type = Input()
python_script = Python(IN[0]=Element_Type)
# ---------- python_script.python (28 lines) ----------
import clr

clr.AddReference('RevitAPI')
clr.AddReference('RevitServices')

from Autodesk.Revit.DB import *
from RevitServices.Persistence import DocumentManager as DM


out = []

try:
	# Element Type
	et = UnwrapElement(IN[0])
	
	doc = DM.Instance.CurrentDBDocument
	
	elements = FilteredElementCollector(doc).OfCategoryId(et.Category.Id).WhereElementIsNotElementType().ToElements()
	
	# Elements of Element Type
	eet = filter(lambda e: e.GetTypeId().Equals(et.Id), elements)
	
	out = et, eet

except AttributeError:
	pass

OUT = out
# ----------------------------------------
Element_Type_and_List_of_Elements = Output(python_script)
