# Dynamo custom node CollectionsFamilyTypesOfFamily.dyf "Family Types of Family" (Dynamo 1.3.3.4111)
# category: Teascripts.Collections.FamilyType
# Retrieves the family types of the family.

Family = Input()
python_script = Python(IN[0]=Family)
# ---------- python_script.python (22 lines) ----------
import clr

clr.AddReference('RevitAPI')
clr.AddReference('RevitServices')

from Autodesk.Revit.DB import *
from RevitServices.Persistence import DocumentManager as DM


family = UnwrapElement(IN[0])

doc = DM.Instance.CurrentDBDocument

elementClassFilter = ElementClassFilter(ElementType)

familyTypes = FilteredElementCollector(doc).OfCategoryId(family.FamilyCategoryId).WherePasses(elementClassFilter).WhereElementIsElementType().ToElements()

data = filter(lambda ft: ft.Family.Id.Equals(family.Id), familyTypes)

out = family, data

OUT = out
# ----------------------------------------
Family_and_List_of_Family_Types = Output(python_script)
