# Dynamo custom node CollectionsGetElementTypesfromElements.dyf "Get Element Types from Elements" (Dynamo 1.3.4.6666)
# category: Teascripts.Collections.ElementTypes
# Retrieves the Element Types from the Elements.

Elements = Input()
python_script = Python(IN[0]=Elements)
# ---------- python_script.python (20 lines) ----------
import clr

clr.AddReference('RevitAPI')
clr.AddReference('RevitServices')

from System.Collections.Generic import List
from Autodesk.Revit.DB import *
from RevitServices.Persistence import DocumentManager as DM

doc = DM.Instance.CurrentDBDocument

#The inputs to this node will be stored as a list in the IN variables.
arg1 = UnwrapElement(IN[0])

eids = List[ElementId](map(lambda x: x.GetTypeId(), arg1))

data = FilteredElementCollector(doc, eids).WhereElementIsElementType().ToElements()

#Assign your output to the OUT variable.
OUT = data
# ----------------------------------------
Element_Types = Output(python_script)
