# Dynamo custom node CollectionsGetElementsByCategory.dyf "Get Elements by Category" (Dynamo 1.3.4.6666)
# category: Teascripts.Collections.Element
# Retrieves the elements by category.

Built_in_Category = Input()  # "Built-in Category"
python_script = Python(IN[0]=Built_in_Category)
# ---------- python_script.python (17 lines) ----------
import clr

clr.AddReference('RevitAPI')
clr.AddReference('RevitServices')

from Autodesk.Revit.DB import *
from RevitServices.Persistence import DocumentManager as DM

#The inputs to this node will be stored as a list in the IN variables.
arg1 = UnwrapElement(IN[0])

doc = DM.Instance.CurrentDBDocument

data = FilteredElementCollector(doc).OfCategory(arg1).WhereElementIsNotElementType().ToElements()

#Assign your output to the OUT variable.
OUT = data
# ----------------------------------------
Elements = Output(python_script)
