# Dynamo custom node CollectionsGetElementsFromElementTypes.dyf "Get Elements from Element Types" (Dynamo 1.3.3.4111)
# category: Teascripts.Collections.Element
# Retrieves the elements from element types

ElementTypes = Input()
python_script = Python(IN[0]=ElementTypes)
# ---------- python_script.python (21 lines) ----------
import clr

clr.AddReference('RevitAPI')
clr.AddReference('RevitServices')

from Autodesk.Revit.DB import *
from RevitServices.Persistence import DocumentManager as DM

familyTypes = UnwrapElement(IN[0])
familyType = familyTypes[0]

doc = DM.Instance.CurrentDBDocument

famInstances = FilteredElementCollector(doc)\
					.OfCategoryId(familyType.Category.Id)\
					.WhereElementIsNotElementType()\
					.ToElements()

out = [filter(lambda fi: fi.GetTypeId().Equals(ft.Id), famInstances) for ft in familyTypes]

OUT = out
# ----------------------------------------
Elements = Output(python_script)
