# Dynamo custom node CollectionsGetFamilyByCategory.dyf "Get Families by Category" (Dynamo 1.3.4.6666)
# category: Teascripts.Collections.Family
# Retrieves the families by category.

BuiltIn_Category = Input()
python_script = Python(IN[0]=BuiltIn_Category)
# ---------- python_script.python (21 lines) ----------
import clr

clr.AddReference('RevitAPI')
clr.AddReference('RevitServices')

from System.Collections.Generic import *
from Autodesk.Revit.DB import *
from RevitServices.Persistence import DocumentManager as DM

#The inputs to this node will be stored as a list in the IN variables.
arg1 = UnwrapElement(IN[0])
doc = DM.Instance.CurrentDBDocument

ecf = ElementClassFilter(Family)
cat = Category.GetCategory(doc, arg1)

families = FilteredElementCollector(doc).WherePasses(ecf)
data = filter(lambda x: x.FamilyCategoryId.Equals(cat.Id), families)

#Assign your output to the OUT variable.
OUT = data
# ----------------------------------------
List_of_Family = Output(python_script)
