# Dynamo custom node CollectionsGetFamilyTypesByCategory.dyf "Get Family Types By Category" (Dynamo 1.3.4.6666)
# category: Teascripts.Collections.FamilyType
# Retrieves the family types grouped by family.

BuiltIn_Category = Input()
python_script = Python(IN[0]=BuiltIn_Category)
# ---------- python_script.python (32 lines) ----------
import clr

clr.AddReference('RevitAPI')
clr.AddReference('RevitServices')

from System.Collections.Generic import *
from Autodesk.Revit.DB import *
from RevitServices.Persistence import DocumentManager as DM

#The inputs to this node will be stored as a list in the IN variables.
cat = UnwrapElement(IN[0])

doc = DM.Instance.CurrentDBDocument

familyClassFilter = ElementClassFilter(Family)

elemClassFilter = ElementClassFilter(ElementType)

cat = Category.GetCategory(doc, cat)

familyCollector = FilteredElementCollector(doc).WherePasses(familyClassFilter)

families = filter(lambda x: x.FamilyCategoryId.Equals(cat.Id), familyCollector)

getfamilySymbols = lambda e: FilteredElementCollector(doc, e.GetFamilySymbolIds()).WherePasses(elemClassFilter)

familySymbols = map(lambda x: getfamilySymbols(x), families)

out = map(lambda x: [y for y in x], familySymbols)

#Assign your output to the OUT variable.
OUT = out
# ----------------------------------------
List_of_Family_Types_by_Family = Output(python_script)
