# Dynamo custom node CollectionsGetFamilyTypesByFamily.dyf "Get Family Types by Family" (Dynamo 1.3.4.6666)
# category: Teascripts.Collections.FamilyType
# Retrieves all the family types by family

List_of_Family = Input()
python_script = Python(IN[0]=List_of_Family)
# ---------- python_script.python (24 lines) ----------
import clr

clr.AddReference('RevitAPI')
clr.AddReference('RevitServices')

from Autodesk.Revit.DB import *
from RevitServices.Persistence import DocumentManager as DM
from System.Collections import *

#The inputs to this node will be stored as a list in the IN variables.
arg1 = UnwrapElement(IN[0])

doc = DM.Instance.CurrentDBDocument

elemClassFilter = ElementClassFilter(ElementType)

getfamilySymbols = lambda e: FilteredElementCollector(doc, e.GetFamilySymbolIds()).WherePasses(elemClassFilter)

familySymbols = map(lambda x: getfamilySymbols(x), arg1)

res = map(lambda x: [y for y in x], familySymbols)

#Assign your output to the OUT variable.
OUT = res
# ----------------------------------------
List_of_Family_Types = Output(python_script)
