# Dynamo custom node Filter by Attribute Key.dyf (Dynamo 1.3.4.6666)
# category: Teascripts.Filter
# Filters the elements by attribute key value.

Elements = Input()
Attribute_Key = Input()
python_script = Python(IN[0]=Elements, IN[1]=Attribute_Key)
# ---------- python_script.python (15 lines) ----------
import clr

clr.AddReference('RevitAPI')

from Autodesk.Revit.DB import *

#The inputs to this node will be stored as a list in the IN variables.
arg1 = UnwrapElement(IN[0])
arg2 = IN[1]

param = "Attribute Key"
data = filter(lambda x: x.LookupParameter(param).AsValueString() == arg2 , arg1)

#Assign your output to the OUT variable.
OUT = data
# ----------------------------------------
Elements_2 = Output(python_script)  # "Elements"
