# Dynamo custom node FilterByParameterAsValueString.dyf "Filter by Parameter As Value String" (Dynamo 1.3.4.6666)
# category: Teascripts.Filter
# Filters the elements by parameter value using AsValueString method

Elements_or_Element_Types = Input()
Parameter_Name = Input()
Parameter_Value = Input()
python_script = Python(IN[0]=Elements_or_Element_Types, IN[1]=Parameter_Name, IN[2]=Parameter_Value)
# ---------- python_script.python (15 lines) ----------
import clr

clr.AddReference('RevitAPI')

from Autodesk.Revit.DB import *

#The inputs to this node will be stored as a list in the IN variables.
elems = UnwrapElement(IN[0])
paramName = IN[1]
paramVal = IN[2]

out = filter(lambda x: x.LookupParameter(paramName).AsValueString().Equals(paramVal), elems)

#Assign your output to the OUT variable.
OUT = out
# ----------------------------------------
Elements = Output(python_script)
