# Dynamo custom node Get Attribute Descriptions.dyf (Dynamo 1.3.4.6666)
# category: Teascripts.Parameters.Elements
# Retrieves the Attribute Description parameter value from the list of elements.

Elements = Input()
python_script = Python(IN[0]=Elements)
# ---------- python_script.python (14 lines) ----------
import clr

clr.AddReference('RevitAPI')

from Autodesk.Revit.DB import *


#The inputs to this node will be stored as a list in the IN variables.
arg1 = UnwrapElement(IN[0])

data = map(lambda x: x.LookupParameter("Attribute Description").AsString(), arg1)

#Assign your output to the OUT variable.
OUT = data
# ----------------------------------------
List_of_Atttribute_Description_Values = Output(python_script)
