# Dynamo custom node ParameterGetAllFamilyTypesParameter.dyf "Get Parameter Names" (Dynamo 1.3.4.6666)
# category: Teascripts.Parameter.Get
# Retrieves parameter names from element and element types.

Elements_or_Element_Type = Input()
python_script = Python(IN[0]=Elements_or_Element_Type)
# ---------- python_script.python (12 lines) ----------
import clr

clr.AddReference('ProtoGeometry')

from Autodesk.DesignScript.Geometry import *


elem = UnwrapElement(IN[0])

out = map(lambda x: x.Definition.Name, elem.Parameters)

OUT = out
# ----------------------------------------
List_of_Parameter_Id_and_Name = Output(python_script)
