# Dynamo custom node ParameterGetParameterValueAsString.dyf "Get Parameter Values As String" (Dynamo 1.3.4.6666)
# category: Teascripts.Parameter.Get
# Retrieves the parameter string value by parameter name.

Elements_or_Element_Types = Input()
Parameter_Name = Input()
python_script = Python(IN[0]=Elements_or_Element_Types, IN[1]=Parameter_Name)
# ---------- python_script.python (15 lines) ----------
import clr

clr.AddReference('RevitAPI')

from Autodesk.Revit.DB import *


#The inputs to this node will be stored as a list in the IN variables.
elems = UnwrapElement(IN[0])
param = IN[1]

out = map(lambda x: x.LookupParameter(param).AsString(), elems)

#Assign your output to the OUT variable.
OUT = out
# ----------------------------------------
Parameter_Values = Output(python_script)
