# Dynamo custom node ParameterSetInstanceParameterValueToTypeParameter.dyf "Set Instance Parameter Value to Type Parameter" (Dynamo 1.3.4.6666)
# category: Teascripts.Parameter.Set
# Sets the instance parameter value to a type parameter.

Elements = Input()
Instance_Parameter_Name = Input()
Type_Parameter_Name = Input()
python_script = Python(IN[0]=Elements, IN[1]=Instance_Parameter_Name, IN[2]=Type_Parameter_Name)
# ---------- python_script.python (38 lines) ----------
import clr

clr.AddReference('RevitAPI')
clr.AddReference('RevitServices')

from Autodesk.Revit.DB import *
from RevitServices.Persistence import DocumentManager as DM
from RevitServices.Transactions import TransactionManager as TM
from System.Collections.Generic import List

#The inputs to this node will be stored as a list in the IN variables.
elems = UnwrapElement(IN[0])
paramName = IN[1]
typeParamName = IN[2]

doc = DM.Instance.CurrentDBDocument

param = map(lambda x: x.LookupParameter(paramName), elems)[0]

paramValue = param.AsString()

elemIds = List[ElementId](map(lambda x: x.GetTypeId(), elems))

elemTypes = FilteredElementCollector(doc, elemIds).WhereElementIsElementType().ToElements()

try:
	TM.Instance.EnsureInTransaction(doc)

	res = map(lambda x: x.LookupParameter(typeParamName).Set(paramValue), elemTypes)
	
except:
	TM.Instance.ForceCloseTransaction()
	
finally:
	TM.Instance.TransactionTaskDone()

#Assign your output to the OUT variable.
OUT = elemTypes, res
# ----------------------------------------
List_of_Element_Types_and_Transaction_Re = Output(python_script)  # "List of Element Types and Transaction Result"
