# Dynamo custom node ParameterSetParameterValues.dyf "Set Parameter Values" (Dynamo 1.3.4.6666)
# category: Teascripts.Parameter.Set
# Sets a list of parameter values for elements

Elements = Input()
Parameter_Name = Input()
List_of_Parameter_Values = Input()
python_script = Python(IN[0]=Elements, IN[1]=Parameter_Name, IN[2]=List_of_Parameter_Values)
# ---------- python_script.python (28 lines) ----------
import clr

clr.AddReference('RevitAPI')
clr.AddReference('RevitServices')

from Autodesk.Revit.DB import *
from RevitServices.Persistence import DocumentManager as DM
from RevitServices.Transactions import TransactionManager as TM

#The inputs to this node will be stored as a list in the IN variables.
elems = UnwrapElement(IN[0])
paramName = IN[1]
paramValues = IN[2]

try:
	doc = DM.Instance.CurrentDBDocument
	TM.Instance.EnsureInTransaction(doc)

	out = map(lambda x, y: x.LookupParameter(paramName).Set(y), elems, paramValues)
	
except:
	TM.Instance.ForceCloseTransaction()
	
finally:
	TM.Instance.TransactionTaskDone()

#Assign your output to the OUT variable.
OUT = out
# ----------------------------------------
List_of_Transaction_Result = Output(python_script)
