# Dynamo custom node ParameterSetandReorderDoorFamilyTypes.dyf "Set and Reorder Door Family Types" (Dynamo 1.3.4.6666)
# category: Teascripts.Parameter.Doors
# Sets and reorder the door family type names.

# group: Takes a single list of entities.
List_of_Door_Family_Types = Input()

python_script = Python(IN[0]=List_of_Door_Family_Types)
# ---------- python_script.python (34 lines) ----------
import clr

clr.AddReference('RevitAPI')
clr.AddReference('RevitServices')

from Autodesk.Revit.DB import *
from RevitServices.Persistence import DocumentManager as DM
from RevitServices.Transactions import TransactionManager as TM

#The inputs to this node will be stored as a list in the IN variables.
elems = UnwrapElement(IN[0])

getDim = lambda x, dim: UnitUtils.Convert(x.LookupParameter(dim).AsDouble(), DisplayUnitType.DUT_DECIMAL_FEET, DisplayUnitType.DUT_MILLIMETERS)

genNum = lambda x: elems.IndexOf(x)+1

genName = lambda x: "{0} - {1} x {2}".format(genNum(x), getDim(x, "Width"), getDim(x, "Height"))

try:
	doc = DM.Instance.CurrentDBDocument
	TM.Instance.EnsureInTransaction(doc)
	
	map(lambda x: Element.Name.SetValue(x, genName(x)), elems)
	
	out = map(lambda x: Element.Name.GetValue(x), elems)
	
except:
	TM.Instance.ForceCloseTransaction()
	
finally:
	TM.Instance.TransactionTaskDone()

#Assign your output to the OUT variable.
OUT = out
# ----------------------------------------
List_of_Door_Family_Type_Names = Output(python_script)
