# Dynamo custom node Set COBie.Component.Description.dyf (Dynamo 1.3.4.6666)
# category: Teascripts.Transactions.Elements
# Sets the value for COBie.Component.Description parameter.

Elements = Input()
List_of_Attribute_Description = Input()
python_script = Python(IN[0]=Elements, IN[1]=List_of_Attribute_Description)
# ---------- python_script.python (29 lines) ----------
import clr

clr.AddReference('RevitAPI')
clr.AddReference('RevitServices')

from Autodesk.Revit.DB import *
from RevitServices.Persistence import DocumentManager as DM
from RevitServices.Transactions import TransactionManager as TM

#The inputs to this node will be stored as a list in the IN variables.
arg1 = UnwrapElement(IN[0])
arg2 = IN[1]

try:
	doc = DM.Instance.CurrentDBDocument
	TM.Instance.EnsureInTransaction(doc)

	data = map(lambda x, y: x.LookupParameter("COBie.Component.Description").Set(y), arg1, arg2)

	TM.Instance.TransactionTaskDone()
	
except:
	TM.Instance.ForceCloseTransaction()
	
finally:
	TM.Instance.TransactionTaskDone()

#Assign your output to the OUT variable.
OUT = data
# ----------------------------------------
List_of_Transaction_Result = Output(python_script)
