# Dynamo custom node Set COBie.Type.Description.dyf (Dynamo 1.3.4.6666)
# category: Teascripts.Transactions.ElementTypes
# Sets the value for COBie.TypeDescription parameter

Element_Types = Input()
COBie_Type_Description_Value = Input()  # "COBie.Type.Description Value"
python_script = Python(IN[0]=Element_Types, IN[1]=COBie_Type_Description_Value)
# ---------- python_script.python (30 lines) ----------
import clr

clr.AddReference('RevitAPI')
clr.AddReference('RevitServices')

from Autodesk.Revit.DB import *
from RevitServices.Persistence import DocumentManager as DM
from RevitServices.Transactions import TransactionManager as TM

#The inputs to this node will be stored as a list in the IN variables.
arg1 = UnwrapElement(IN[0])
arg2 = IN[1]

try:
	doc = DM.Instance.CurrentDBDocument
	TM.Instance.EnsureInTransaction(doc)
	
	param = 'COBie.Type.Description'
	data = map(lambda x: x.LookupParameter(param).Set(arg2), arg1)
	
	TM.Instance.TransactionTaskDone()

except:
	TM.Instance.ForceCloseTransaction()
	
finally:
	TM.Instance.TransactionTaskDone()

#Assign your output to the OUT variable.
OUT = data
# ----------------------------------------
List_of_Results = Output(python_script)
