# Dynamo custom node Set COBie.dyf (Dynamo 1.3.4.6666)
# category: Teascripts.Transactions.Elements
# Set the value for COBie parameter.

Elements = Input()
COBie_Value = Input()
python_script = Python(IN[0]=Elements, IN[1]=COBie_Value)
# ---------- python_script.python (27 lines) ----------
import clr

clr.AddReference('RevitServices')

from RevitServices.Persistence import DocumentManager as DM
from RevitServices.Transactions import TransactionManager as TM

#The inputs to this node will be stored as a list in the IN variables.
arg1 = UnwrapElement(IN[0])
arg2 = IN[1]

try:
	doc = DM.Instance.CurrentDBDocument
	TM.Instance.EnsureInTransaction(doc)
	param = "COBie"
	data = map(lambda x: x.LookupParameter(param).Set(arg2), arg1)
	
	TM.Instance.TransactionTaskDone()

except:
	TM.Instance.ForceCloseTransaction()
	
finally:
	TM.Instance.TransactionTaskDone()

#Assign your output to the OUT variable.
OUT = data
# ----------------------------------------
List_of_Results = Output(python_script)
