# Dynamo custom node Set and Reorder Door Family Types.dyf (Dynamo 1.3.4.6666)
# category: Teascripts.Transactions.Doors
# Sets and reorder the door family type names.

List_of_Door_Family_Types = Input()
python_script = Python(IN[0]=List_of_Door_Family_Types)
# ---------- python_script.python (36 lines) ----------
import clr

clr.AddReference('RevitAPI')
clr.AddReference('RevitServices')

from Autodesk.Revit.DB import *
from RevitServices.Persistence import DocumentManager as DM
from RevitServices.Transactions import TransactionManager as TM

#The inputs to this node will be stored as a list in the IN variables.
arg1 = UnwrapElement(IN[0])

genNum = lambda x, y: x.IndexOf(y)+1

getName = lambda x: Element.Name.GetValue(x)

getDim = lambda x, dim: UnitUtils.Convert(x.LookupParameter(dim).AsDouble(), DisplayUnitType.DUT_DECIMAL_FEET, DisplayUnitType.DUT_MILLIMETERS)

genName = lambda x, y: "{0} - {1} x {2}".format(genNum(x, y), getDim(y, "Width"), getDim(y, "Height"))

try:
	doc = DM.Instance.CurrentDBDocument
	TM.Instance.EnsureInTransaction(doc)
	
	map(lambda x: [Element.Name.SetValue(y, genName(x, y)) for y in x], arg1)
	
	data = map(lambda x: [Element.Name.GetValue(y) for y in x], arg1)
	
except:
	TM.Instance.ForceCloseTransaction()
	
finally:
	TM.Instance.TransactionTaskDone()

#Assign your output to the OUT variable.
OUT = data
# ----------------------------------------
List_of_Door_Family_Type_Names = Output(python_script)
