# Dynamo custom node ElementsByCategory.dyf "Elements by Category" (Dynamo 1.3.4.6666)
# category: Teascripts.Collections.Element
# Retrieves the elements by category.

category = Input()
python_script = Python(IN[0]=category)
# ---------- python_script.python (11 lines) ----------
import sys

sys.path.append('C:/ProgramData/Dynamo/Dynamo Revit/1.3/definitions/teascripts-dynamo/')

from core import *

category = UnwrapElement(IN[0])

out = collect_elements_by_category(category)

OUT = out
# ----------------------------------------
elements = Output(python_script)
