# Dynamo custom node ElementsOfElementTypes.dyf "Elements of Element Type" (Dynamo 1.3.3.4111)
# category: Teascripts.Collections.Element
# Retrieves the elements of element type

element_type = Input()
python_script = Python(IN[0]=element_type)
# ---------- python_script.python (12 lines) ----------
import sys

sys.path.append('C:/ProgramData/Dynamo/Dynamo Revit/1.3/definitions/teascripts-dynamo/')

from core import *


element_type = UnwrapElement(IN[0])

out = elements_of_element_types(element_type)

OUT = out
# ----------------------------------------
element_type_and_elements = Output(python_script)
