# Dynamo custom node ElementTypesByCategory.dyf "Element Types by Category" (Dynamo 1.3.4.6666)
# category: Teascripts.Collections.ElementType
# Retrieves the element types by category

category = Input()
python_script = Python(IN[0]=category)
# ---------- python_script.python (12 lines) ----------
import sys

sys.path.append('C:/ProgramData/Dynamo/Dynamo Revit/1.3/definitions/teascripts-dynamo/')

from core import *

# data entering node
category = UnwrapElement(IN[0])

out = collect_element_types_by_category(category)

OUT = out
# ----------------------------------------
list_of_element_type = Output(python_script)
