# Dynamo custom node ElementTypesOfElements.dyf "Element Types of Elements" (Dynamo 1.3.4.6666)
# category: Teascripts.Collections.ElementType
# Retrieves the element types from the elements.

elements = Input()
python_script = Python(IN[0]=elements)
# ---------- python_script.python (12 lines) ----------
import sys

sys.path.append('C:/ProgramData/Dynamo/Dynamo Revit/1.3/definitions/teascripts-dynamo/')

from core import *

# data entering node
elements = UnwrapElement(IN[0])

out = element_types_of_elements(elements)

OUT = out
# ----------------------------------------
element_types = Output(python_script)
