# Dynamo custom node ElementTypesOfFamily.dyf "Element Types of Family" (Dynamo 1.3.3.4111)
# category: Teascripts.Collections.ElementType
# Retrieves the family types of the family.

family = Input()
python_script = Python(IN[0]=family)
# ---------- python_script.python (13 lines) ----------
import sys

sys.path.append('C:/ProgramData/Dynamo/Dynamo Revit/1.3/definitions/teascripts-dynamo/')

from core import *


# data entering node
family = UnwrapElement(IN[0])

out = element_types_of_family(family)

OUT = out
# ----------------------------------------
list_of_family_types = Output(python_script)
