# Dynamo custom node ElementTypesOfElements.dyf "Element Types of Elements" (Dynamo 1.3.4.6666)
# category: Teascripts.Collections.ElementTypes
# Retrieves the element types from the elements.

elements = Input()
python_script = Python(IN[0]=elements)
# ---------- python_script.python (18 lines) ----------
import clr

clr.AddReference('RevitAPI')
clr.AddReference('RevitServices')

from System.Collections.Generic import List
from Autodesk.Revit.DB import *
from RevitServices.Persistence import DocumentManager as DM


elements = UnwrapElement(IN[0])
doc = DM.Instance.CurrentDBDocument

element_ids = List[ElementId](map(lambda element: element.GetTypeId(), elements))

data = FilteredElementCollector(doc, element_ids).WhereElementIsElementType().ToElements()

OUT = data
# ----------------------------------------
element_types = Output(python_script)
