# Dynamo custom node ElementsByCategory.dyf "Elements by Category" (Dynamo 1.3.4.6666)
# category: Teascripts.Collections.Element
# Retrieves the elements by category.

category = Input()
python_script = Python(IN[0]=category)
# ---------- python_script.python (14 lines) ----------
import clr

clr.AddReference('RevitAPI')
clr.AddReference('RevitServices')

from Autodesk.Revit.DB import *
from RevitServices.Persistence import DocumentManager as DM

document = DM.Instance.CurrentDBDocument
category = UnwrapElement(IN[0])

out = FilteredElementCollector(document).OfCategoryId(category.Id).WhereElementIsNotElementType().ToElements()

OUT = out
# ----------------------------------------
elements = Output(python_script)
