# Dynamo custom node ElementsOfElementTypes.dyf "Elements of Element Type" (Dynamo 1.3.3.4111)
# category: Teascripts.Collections.Element
# Retrieves the elements of element type

element_type = Input()
python_script = Python(IN[0]=element_type)
# ---------- python_script.python (18 lines) ----------
import clr

clr.AddReference('RevitAPI')
clr.AddReference('RevitServices')

from Autodesk.Revit.DB import *
from RevitServices.Persistence import DocumentManager as DM


document = DM.Instance.CurrentDBDocument
element_type = UnwrapElement(IN[0])

elements = FilteredElementCollector(document).OfCategoryId(element_type.Category.Id).WhereElementIsNotElementType().ToElements()
elements_of_element_type = filter(lambda element: element.GetTypeId().Equals(element_type.Id), elements)

out = element_type, elements_of_element_type

OUT = out
# ----------------------------------------
element_type_and_elements = Output(python_script)
