# Dynamo custom node GetElementsOfElementTypes.dyf "Get Elements of Element Types" (Dynamo 1.3.3.4111)
# category: Teascripts.Collections.Element
# Retrieves the elements of the element types

element_types = Input()
python_script = Python(IN[0]=element_types)
# ---------- python_script.python (21 lines) ----------
import clr

clr.AddReference('RevitAPI')
clr.AddReference('RevitServices')

from Autodesk.Revit.DB import *
from RevitServices.Persistence import DocumentManager as DM


doc = DM.Instance.CurrentDBDocument
familyTypes = UnwrapElement(IN[0])
familyType = familyTypes[0]

famInstances = FilteredElementCollector(doc)\
					.OfCategoryId(familyType.Category.Id)\
					.WhereElementIsNotElementType()\
					.ToElements()

out = [filter(lambda fi: fi.GetTypeId().Equals(ft.Id), famInstances) for ft in familyTypes]

OUT = out
# ----------------------------------------
elements = Output(python_script)
