# Dynamo custom node FamilyByCategory.dyf "Families by Category" (Dynamo 1.3.4.6666)
# category: Teascripts.Collections.Family
# Retrieves the families by category.

category = Input()
python_script = Python(IN[0]=category)
# ---------- python_script.python (17 lines) ----------
import clr

clr.AddReference('RevitAPI')
clr.AddReference('RevitServices')

from System.Collections.Generic import *
from Autodesk.Revit.DB import *
from RevitServices.Persistence import DocumentManager as DM


document = DM.Instance.CurrentDBDocument
category = UnwrapElement(IN[0])

families = FilteredElementCollector(document).WherePasses(ElementClassFilter(Family))
out = filter(lambda family: family.FamilyCategoryId.Equals(category.Id), families)

OUT = out
# ----------------------------------------
families = Output(python_script)
