# Dynamo custom node FamilyTypesByCategory.dyf "Family Types By Category" (Dynamo 1.3.4.6666)
# category: Teascripts.Collections.FamilyType
# Retrieves the family types grouped by family.

category = Input()
python_script = Python(IN[0]=category)
# ---------- python_script.python (24 lines) ----------
import clr

clr.AddReference('RevitAPI')
clr.AddReference('RevitServices')

from System.Collections.Generic import *
from Autodesk.Revit.DB import *
from RevitServices.Persistence import DocumentManager as DM


document = DM.Instance.CurrentDBDocument
category = UnwrapElement(IN[0])

families = FilteredElementCollector(document).WherePasses(ElementClassFilter(Family))

filtered_families = filter(lambda x: x.FamilyCategoryId.Equals(category.Id), families)

get_family_symbols = lambda family: FilteredElementCollector(document, family.GetFamilySymbolIds()).WherePasses(ElementClassFilter(ElementType))

family_symbols = map(lambda family: get_family_symbols(family), filtered_families)

out = map(lambda x: [y for y in x], family_symbols)

OUT = out
# ----------------------------------------
list_of_family_types_by_family = Output(python_script)
