# Dynamo custom node FamilyTypesOfFamilies.dyf "Family Types of Families" (Dynamo 1.3.4.6666)
# category: Teascripts.Collections.FamilyType
# Retrieves all the family types by family

families = Input()
python_script = Python(IN[0]=families)
# ---------- python_script.python (20 lines) ----------
import clr

clr.AddReference('RevitAPI')
clr.AddReference('RevitServices')

from Autodesk.Revit.DB import *
from RevitServices.Persistence import DocumentManager as DM
from System.Collections import *


document = DM.Instance.CurrentDBDocument
families = UnwrapElement(IN[0])

get_family_symbols = lambda e: FilteredElementCollector(document, e.GetFamilySymbolIds()).WherePasses(ElementClassFilter(ElementType))

familySymbols = map(lambda family: get_family_symbols(family), families)

out = map(lambda x: [y for y in x], familySymbols)

OUT = out
# ----------------------------------------
list_of_family_types_by_family = Output(python_script)
