# Dynamo custom node FamilyTypesOfFamily.dyf "Family Types of Family" (Dynamo 1.3.3.4111)
# category: Teascripts.Collections.FamilyType
# Retrieves the family types of the family.

family = Input()
python_script = Python(IN[0]=family)
# ---------- python_script.python (17 lines) ----------
import clr

clr.AddReference('RevitAPI')
clr.AddReference('RevitServices')

from Autodesk.Revit.DB import *
from RevitServices.Persistence import DocumentManager as DM


document = DM.Instance.CurrentDBDocument
family = UnwrapElement(IN[0])

familyTypes = FilteredElementCollector(document).OfCategoryId(family.FamilyCategoryId).WhereElementIsElementType().ToElements()

out = filter(lambda ft: ft.Family.Id.Equals(family.Id), familyTypes)

OUT = out
# ----------------------------------------
list_of_family_types = Output(python_script)
