# Dynamo custom node BasicWallElements.dyf "Basic Wall Instances" (Dynamo 1.3.4.6666)
# category: Teascripts.Collections.Walls
# Retrieves the basic wall instances in the project model.

python_script = Python()  # unwired: IN[0]
# ---------- python_script.python (16 lines) ----------
import clr

clr.AddReference('RevitAPI')
clr.AddReference('RevitServices')

from Autodesk.Revit.DB import *
from RevitServices.Persistence import DocumentManager as DM


document = DM.Instance.CurrentDBDocument

walls = FilteredElementCollector(document).OfCategory(BuiltInCategory.OST_Walls).OfClass(Wall).WhereElementIsNotElementType().ToElements()

out = filter(lambda wall: wall.WallType.Kind.Equals(WallKind.Basic), walls)

OUT = out
# ----------------------------------------
basic_wall_elements = Output(python_script)
