# Dynamo custom node BasicWallTypes.dyf "Get Basic Wall Types" (Dynamo 1.3.4.6666)
# category: Teascripts.Collections.Walls
# Retrieves all the basic wall types in the project model.

python_script = Python()  # unwired: IN[0]
# ---------- python_script.python (15 lines) ----------
import clr
clr.AddReference('RevitAPI')
clr.AddReference('RevitServices')

from Autodesk.Revit.DB import *
from RevitServices.Persistence import DocumentManager as DM


document = DM.Instance.CurrentDBDocument

wall_types = FilteredElementCollector(document).OfCategory(BuiltInCategory.OST_Walls).OfClass(WallType).ToElements()
			
out = filter(lambda wall_type: wall_type.Kind.Equals(WallKind.Basic), wall_types)

OUT = out
# ----------------------------------------
basic_wall_types = Output(python_script)
