# Dynamo custom node FilterByParameterAsValueString.dyf "Filter by Parameter As Value String" (Dynamo 1.3.4.6666)
# category: Teascripts.Filter
# Filters the elements by parameter value using AsValueString method

element_or_element_type = Input()  # "element or  element type"
parameter_name = Input()
parameter_value = Input()
python_script = Python(IN[0]=element_or_element_type, IN[1]=parameter_name, IN[2]=parameter_value)
# ---------- python_script.python (13 lines) ----------
import clr

clr.AddReference('RevitAPI')

from Autodesk.Revit.DB import *

elements = UnwrapElement(IN[0])
parameter_name = IN[1]
parameter_value = IN[2]

out = filter(lambda element: element.LookupParameter(parameter_name).AsValueString().Equals(parameter_value), elements)

OUT = out
# ----------------------------------------
elements_or_element_types = Output(python_script)
