# Dynamo custom node FilterStartsWithParameterValue.dyf "Filter Starts With Parameter Value" (Dynamo 1.3.4.6666)
# category: Teascripts.Filter
# Filters element type that starts with some string value of a parameter.

elements_or_element_types = Input()
parameter_name = Input()
parameter_value = Input()
python_script = Python(IN[0]=elements_or_element_types, IN[1]=parameter_name, IN[2]=parameter_value)
# ---------- python_script.python (20 lines) ----------
import clr

clr.AddReference('RevitAPI')

from Autodesk.Revit.DB import *

#The inputs to this node will be stored as a list in the IN variables.
in_0 = IN[0]
in_1 = IN[1]
in_2 = IN[2]

element_types = UnwrapElement(in_0)
param_name = in_1
param_value = in_2

starts_with = lambda x: str(x.LookupParameter(param_name).AsString()).startswith(param_value)

out = filter(lambda et: starts_with(et), element_types)

OUT = out
# ----------------------------------------
list_of_element_types = Output(python_script)
