# Dynamo custom node FormatDescription.dyf "Format Description" (Dynamo 1.3.4.6666)
# category: Teascripts.Format
# Process the description for elements and element types

family_types = Input()
additional_description = Input()
python_script = Python(IN[0]=family_types, IN[1]=additional_description)
# ---------- python_script.python (15 lines) ----------
import clr

clr.AddReference('RevitAPI')

from Autodesk.Revit.DB import *


family_types = UnwrapElement(IN[0])
ad = IN[1] # additional description

format_description = lambda ft: str(Element.Name.GetValue(ft)).split(' - ')[1] + " " + ad

out = map(lambda ft: format_description(ft), family_types)

OUT = out
# ----------------------------------------
list_of_description = Output(python_script)
