# Dynamo custom node FormatTypeMarks.dyf "Format Type Marks" (Dynamo 1.3.4.6666)
# category: Teascripts.Format
# Processes the type marks for the family types

family_types = Input()
key = Input()
python_script = Python(IN[0]=family_types, IN[1]=key)
# ---------- python_script.python (13 lines) ----------
# data entering nodes
fts = UnwrapElement(IN[0]) # family types
key = IN[1]

# generate type mark
gen_type_mark = lambda x: str.format('{0}-{1}', key, fts.IndexOf(x)+1)

# result
res = map(lambda ft: gen_type_mark(ft), fts)

out = fts, res

OUT = out
# ----------------------------------------
code_block = CodeBlock(data=python_script) { data[0]; data[1]; }
family_types_2 = Output(code_block.out0)  # "family types"
type_marks = Output(code_block.out1)
