# Dynamo custom node GetDoubleParameterNamesAndValues.dyf "Get Double Parameter Names and Values" (Dynamo 1.3.4.6666)
# category: Teascripts.Parameter.Get
# Retrieves the double parameter names and values.

element_or_element_type = Input()
python_script = Python(IN[0]=element_or_element_type)
# ---------- python_script.python (14 lines) ----------
import clr

clr.AddReference('RevitAPI')

from Autodesk.Revit.DB import *


element = UnwrapElement(IN[0])

convert = lambda param: UnitUtils.Convert(param.AsDouble(), DisplayUnitType.DUT_DECIMAL_FEET, DisplayUnitType.DUT_MILLIMETERS)

out = [[parameter.Definition.Name, convert(parameter)] for parameter in element.GetOrderedParameters() if parameter.StorageType.Equals(StorageType.Double)]

OUT = out
# ----------------------------------------
parameter_names_and_values = Output(python_script)
