# Dynamo custom node GetIntegerParameterNamesAndValues.dyf "Get Integer Parameter Names And Values" (Dynamo 1.3.4.6666)
# category: Teascripts.Parameter.Get
# Retrieves the integer parameter nams and values.

element_or_element_type = Input()
python_script = Python(IN[0]=element_or_element_type)
# ---------- python_script.python (12 lines) ----------
import clr

clr.AddReference('RevitAPI')

from Autodesk.Revit.DB import *


element = UnwrapElement(IN[0])

out = [[parameter.Definition.Name, parameter.AsInteger()] for parameter in element.GetOrderedParameters() if parameter.StorageType.Equals(StorageType.Integer)]

OUT = out
# ----------------------------------------
parameter_names_and_values = Output(python_script)
