# Dynamo custom node GetParameterNames.dyf "Get Parameter Names" (Dynamo 1.3.4.6666)
# category: Teascripts.Parameter.Get
# Retrieves the parameter names from element or element type.

element_or_element_type = Input()
python_script = Python(IN[0]=element_or_element_type)
# ---------- python_script.python (12 lines) ----------
import clr

clr.AddReference('ProtoGeometry')

from Autodesk.DesignScript.Geometry import *


element = UnwrapElement(IN[0])

out = map(lambda parameter: parameter.Definition.Name, element.Parameters)

OUT = out
# ----------------------------------------
list_of_parameter_names = Output(python_script)
