# Dynamo custom node GetParameterValueAsString.dyf "Get Parameter Values As String" (Dynamo 1.3.4.6666)
# category: Teascripts.Parameter.Get
# Retrieves the parameter string value by parameter name.

element_or_element_type = Input()
parameter_name = Input()
python_script = Python(IN[0]=element_or_element_type, IN[1]=parameter_name)
# ---------- python_script.python (13 lines) ----------
import clr

clr.AddReference('RevitAPI')

from Autodesk.Revit.DB import *


elements = UnwrapElement(IN[0])
parameter_name = IN[1]

out = map(lambda element: element.LookupParameter(parameter_name).AsString(), elements)

OUT = out
# ----------------------------------------
parameter_values = Output(python_script)
