# Dynamo custom node GetTextParameterNamesAndValues.dyf "Get Text Parameter Names and Values" (Dynamo 1.3.4.6666)
# category: Teascripts.Parameter.Get
# Retrieves the text parameter name and value.

element_or_element_type = Input()
python_script = Python(IN[0]=element_or_element_type)
# ---------- python_script.python (12 lines) ----------
import clr

clr.AddReference('RevitAPI')

from Autodesk.Revit.DB import *


element = UnwrapElement(IN[0])

out = [[parameter.Definition.Name, parameter.AsString()] for parameter in element.GetOrderedParameters() if parameter.StorageType.Equals(StorageType.String)]

OUT = out
# ----------------------------------------
parameter_names_and_values = Output(python_script)
