# Dynamo custom node SetInstanceParameterValueToTypeParameter.dyf "Set Instance Parameter Value to Type Parameter" (Dynamo 1.3.4.6666)
# category: Teascripts.Parameter.Set
# Sets the instance parameter value to a type parameter.

elements = Input()
instance_parameter_name = Input()
type_parameter_name = Input()
python_script = Python(IN[0]=elements, IN[1]=instance_parameter_name, IN[2]=type_parameter_name)
# ---------- python_script.python (37 lines) ----------
import clr

clr.AddReference('RevitAPI')
clr.AddReference('RevitServices')

from Autodesk.Revit.DB import *
from RevitServices.Persistence import DocumentManager as DM
from RevitServices.Transactions import TransactionManager as TM
from System.Collections.Generic import List


document = DM.Instance.CurrentDBDocument
elements = UnwrapElement(IN[0])
inst_parameter_name = IN[1]
type_parameter_name = IN[2]
res = []

inst_parameter = map(lambda element: element.LookupParameter(inst_parameter_name), elements)[0]

inst_parameter_value = inst_parameter.AsString()

element_ids = List[ElementId](map(lambda element: element.GetTypeId(), elements))

element_types = FilteredElementCollector(document, element_ids).WhereElementIsElementType().ToElements()

try:
	TM.Instance.EnsureInTransaction(doc)

	res = map(lambda element_type: element_type.LookupParameter(type_parameter_name).Set(inst_parameter_value), element_types)
	
except:
	TM.Instance.ForceCloseTransaction()
	
finally:
	TM.Instance.TransactionTaskDone()

OUT = element_types, res
# ----------------------------------------
list_of_element_eypes_and_transaction_re = Output(python_script)  # "list of element eypes and transaction result"
