# Dynamo custom node SetParameterValue.dyf "Set Parameter Value" (Dynamo 1.3.4.6666)
# category: Teascripts.Parameter.Set
# Sets a parameter value for elements

elements_or_element_types = Input()
parameter_name = Input()
parameter_value = Input()
python_script = Python(IN[0]=elements_or_element_types, IN[1]=parameter_name, IN[2]=parameter_value)
# ---------- python_script.python (27 lines) ----------
import clr

clr.AddReference('RevitAPI')
clr.AddReference('RevitServices')

from Autodesk.Revit.DB import *
from RevitServices.Persistence import DocumentManager as DM
from RevitServices.Transactions import TransactionManager as TM


document = DM.Instance.CurrentDBDocument
elements = UnwrapElement(IN[0])
parameter_name = IN[1]
parameter_value = IN[2]

try:
	TM.Instance.EnsureInTransaction(document)

	out = map(lambda element: element.LookupParameter(parameter_name).Set(parameter_value), elements)
	
except:
	TM.Instance.ForceCloseTransaction()
	
finally:
	TM.Instance.TransactionTaskDone()

OUT = out
# ----------------------------------------
list_of_transaction_result = Output(python_script)
