# Dynamo custom node SetParameterValues.dyf "Set Parameter Values" (Dynamo 1.3.4.6666)
# category: Teascripts.Parameter.Set
# Sets a list of parameter values for elements

elements = Input()
parameter_name = Input()
list_of_parameter_values = Input()
python_script = Python(IN[0]=elements, IN[1]=parameter_name, IN[2]=list_of_parameter_values)
# ---------- python_script.python (27 lines) ----------
import clr

clr.AddReference('RevitAPI')
clr.AddReference('RevitServices')

from Autodesk.Revit.DB import *
from RevitServices.Persistence import DocumentManager as DM
from RevitServices.Transactions import TransactionManager as TM


document = DM.Instance.CurrentDBDocument
elements = UnwrapElement(IN[0])
parameter_name = IN[1]
parameter_values = IN[2]

try:
	TM.Instance.EnsureInTransaction(document)

	out = map(lambda element, parameter_value: element.LookupParameter(parameter_name).Set(parameter_value), elements, parameter_values)
	
except:
	TM.Instance.ForceCloseTransaction()
	
finally:
	TM.Instance.TransactionTaskDone()

OUT = out
# ----------------------------------------
list_of_transaction_result = Output(python_script)
