# Dynamo custom node SetandReorderDoorFamilyTypes.dyf "Set and Reorder Door Family Types" (Dynamo 1.3.4.6666)
# category: Teascripts.Parameter.Doors
# Sets and reorder the door family type names.

# group: Takes a single list of entities.
list_of_door_family_types = Input()

python_script = Python(IN[0]=list_of_door_family_types)
# ---------- python_script.python (33 lines) ----------
import clr

clr.AddReference('RevitAPI')
clr.AddReference('RevitServices')

from Autodesk.Revit.DB import *
from RevitServices.Persistence import DocumentManager as DM
from RevitServices.Transactions import TransactionManager as TM


document = DM.Instance.CurrentDBDocument
elements = UnwrapElement(IN[0])

get_dim = lambda x, dim: UnitUtils.Convert(x.LookupParameter(dim).AsDouble(), DisplayUnitType.DUT_DECIMAL_FEET, DisplayUnitType.DUT_MILLIMETERS)

generate_num = lambda element: elements.IndexOf(element)+1

generate_name = lambda element: "{0} - {1} x {2}".format(generate_num(element), get_dim(element, "Width"), get_dim(element, "Height"))

try:
	TM.Instance.EnsureInTransaction(document)
	
	map(lambda element: Element.Name.SetValue(element, generate_name(x)), elements)
	
	out = map(lambda element: Element.Name.GetValue(element), elements)
	
except:
	TM.Instance.ForceCloseTransaction()
	
finally:
	TM.Instance.TransactionTaskDone()

OUT = out
# ----------------------------------------
list_of_door_family_type_names = Output(python_script)
