# Dynamo custom node SetCOBieType.dyf "Set COBie.Type" (Dynamo 1.3.4.6666)
# category: Teascripts.Parameter.Set.COBieType
# Set value COBie.Type parameter

element_types = Input()
int = Input()
python_script = Python(IN[0]=element_types, IN[1]=int)
# ---------- python_script.python (42 lines) ----------
import clr
import sys

sys.path.append('C:/ProgramData/Dynamo/Dynamo Revit/1.3/definitions/teascripts-dynamo/')

clr.AddReference('RevitServices')

from core import *
from RevitServices.Persistence import DocumentManager as DM
from RevitServices.Transactions import TransactionManager as TM


doc = DM.Instance.CurrentDBDocument
out = []

# data entering node
in_0 = UnwrapElement(IN[0])
in_1 = IN[1]

element_types = in_0
param_name = 'COBie.Type'
param_value = in_1

try:
    TM.Instance.EnsureInTransaction(doc)
    map(lambda et: set_cobie_type(et, param_value), element_types)

    if param_value == 1:
        map(lambda et: set_cobie_type_created_on(et), element_types)

    else:
        map(lambda et: et.LookupParameter('COBie.Type.CreatedOn').Set(''), element_types)

    out = map(lambda et: et.LookupParameter(param_name).AsInteger(), element_types)
    
except:
    TM.Instance.ForceCloseTransaction()

finally:
    TM.Instance.TransactionTaskDone()

OUT = out
# ----------------------------------------
