# Dynamo custom node SetCOBieTypeDescription.dyf "Set COBie.Type.Description" (Dynamo 1.3.4.6666)
# category: Teascripts.Parameter.Set.COBieType
# Set values for COBie.Type.Description parameter.

element_types = Input()
python_script = Python(IN[0]=element_types)
# ---------- python_script.python (34 lines) ----------
import clr
import sys

sys.path.append('C:/ProgramData/Dynamo/Dynamo Revit/1.3/definitions/teascripts-dynamo/')

clr.AddReference('RevitServices')

from core import *
from RevitServices.Persistence import DocumentManager as DM
from RevitServices.Transactions import TransactionManager as TM


doc = DM.Instance.CurrentDBDocument
out = []

# data entering node
in_0 = UnwrapElement(IN[0])

element_types = in_0
param_name = 'COBie.Type.Description'

try:
    TM.Instance.EnsureInTransaction(doc)
    map(lambda et: set_cobie_type_description(et), element_types)

    out = map(lambda et: et.LookupParameter(param_name).AsString(), element_types)
    
except:
    TM.Instance.ForceCloseTransaction()

finally:
    TM.Instance.TransactionTaskDone()

OUT = out
# ----------------------------------------
